# Grasshopper definition triggerUnconnected.gh (Grasshopper 1.0.7)
# plug-ins: Eddy3D

abl = ABL(Uref=5, Zref=10, Z0=1, ZGround=0)
geo = Geometry(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)

# ----
# 2. Simulation Domain
domainbox = BoxShapedDomain(Terrain=geo, BoundaryCondition=abl, BlockSize=20)  # -> Domain, Mesh

ghpython_script = GhPythonScript()  # -> Out, A
ghpython_script_2 = GhPythonScript()  # -> Out, A
cluster = Cluster_2()
cluster_2 = Cluster_2()
data = Data(cluster_2)
merge = Merge(Data1=ghpython_script.A, Data2=ghpython_script_2.A, Data3=data)

only_selected_components = BooleanToggle(False)
# trigger objects without inputs:
run = Button()
ghpython_script_3 = GhPythonScript(run=run, mode=only_selected_components)  # -> log; inputs mode: Boolean
# ---------- ghpython_script_3: Python ----------
__author__ = "Serjoscha Düring"
__version__ = "2023.09.21"

import Grasshopper as gh
import Rhino as rh
import rhinoscriptsyntax as rs
import System



def create_trigger(doc, component):
    pt = component.Attributes.Bounds.Location
    pt.X -= 150
    
    ghPythonId = ghenv.Component.ComponentGuid
    pythonComponent = gh.GH_InstanceServer.ComponentServer.EmitObject(ghPythonId)
    doc.AddObject(pythonComponent, False)
    
    attr = pythonComponent.Attributes
    attr.Pivot = pt
    pythonComponent.Attributes = attr
    
    targetGuidStr = str(component.InstanceGuid)
    
    # set code of trigger component
    pythonComponent.Code = """
import Grasshopper as gh
import System
targetGuid = System.Guid("{}")
target = ghenv.Component.OnPingDocument().FindObject(targetGuid, False)
if trigger:
    target.ExpireSolution(True)
linkedComp = "{}"
""".format(targetGuidStr, targetGuidStr)

    pythonComponent.NickName = "triggerComp"
    pythonComponent.Name = "triggerComp"
    pythonComponent.Description = "Generated Trigger for: " + targetGuidStr
    
    trigger_param = gh.Kernel.Parameters.Param_GenericObject()
    trigger_param.NickName = "trigger"
    trigger_param.Name = "trigger"
    trigger_param.Description = "Trigger to expire the target component"
    trigger_param.Access = gh.Kernel.GH_ParamAccess.item
    trigger_param.Optional = True
    pythonComponent.Params.RegisterInputParam(trigger_param)
    
    # Remove default input/output
    pythonComponent.Params.UnregisterInputParameter(pythonComponent.Params.Input[0])
    pythonComponent.Params.UnregisterInputParameter(pythonComponent.Params.Input[0])
    pythonComponent.Params.UnregisterOutputParameter(pythonComponent.Params.Output[0])
    pythonComponent.Params.Output[0].NickName = "linkedComp"
    pythonComponent.Params.Output[0].Name = "linkedComp"
    pythonComponent.Params.Output[0].Description = "Guid of the linked component"
    
    # add target guid as output, so its immediatly accessible
    gh_string = gh.Kernel.Types.GH_String(targetGuidStr)
    pythonComponent.Params.Output[0].ClearData()
    pythonComponent.Params.Output[0].AddVolatileData(gh.Kernel.Data.GH_Path(0), 0, gh_string)


    pythonComponent.Params.OnParametersChanged()
    
    return pythonComponent


def main():
    # Get the active Grasshopper document
    doc = ghenv.Component.OnPingDocument()
    
    initial_trigger_count = 0
    existing_targets = set()
    for obj in doc.Objects:
        if isinstance(obj, gh.Kernel.GH_Component) and obj.NickName == "triggerComp":
            target_guid_str = obj.Params.Output[0].VolatileData.get_Branch(0)[0].Value
            target_guid = System.Guid(target_guid_str)
            existing_targets.add(target_guid)
            initial_trigger_count += 1
            print("Existing target:", target_guid)

    
    # Iterate through all objects or just the selected ones based on your choice
    objects = doc.SelectedObjects() if mode else doc.Objects
    
    components_without_inputs = []

    for obj in objects:
        # Check if it's a component
        if isinstance(obj, gh.Kernel.GH_Component):
            # Check if the component doesn't have any input parameters
            if len(obj.Params.Input) == 0:
                components_without_inputs.append(obj)
    new_trigger_count = 0
    for comp in components_without_inputs:
        # Skip if this component already has a trigger
        if comp.InstanceGuid in existing_targets:
            continue
        
        # Create the python trigger component
        pythonComponent = create_trigger(doc, comp)
        new_trigger_count += 1
        
        # Group the target and newly created component
        newGroup = gh.Kernel.Special.GH_Group()
        newGroup.AddObject(comp.InstanceGuid)
        newGroup.AddObject(pythonComponent.InstanceGuid)
        newGroup.Colour = System.Drawing.Color.FromArgb(10, 10, 10)
        newGroup.NickName = "triggered by triggerComp"
        doc.AddObject(newGroup, False)
        
    log = "Initial Trigger Components: {}\nNewly Added: {}\nTotal Trigger Components: {}".format(initial_trigger_count, new_trigger_count, new_trigger_count+initial_trigger_count)

    return log 


                
                
# Set 'optionB' to True if you want to consider only selected components, otherwise False for all.

log = main()
# ---------- end ghpython_script_3 ----------

# ---- group: triggered by triggerComp
triggercomp = TriggerComp()  # -> linkedComp
#   port trigger: Trigger to expire the target component
# ---------- triggercomp: Python ----------
import Grasshopper as gh
import System
targetGuid = System.Guid("bfdb95a8-68e1-446f-95e9-06144fe3f43c")
target = ghenv.Component.OnPingDocument().FindObject(targetGuid, False)
if trigger:
    target.ExpireSolution(True)
linkedComp = "bfdb95a8-68e1-446f-95e9-06144fe3f43c"
# ---------- end triggercomp ----------
cluster_3 = Cluster_2()

triggercomp_2 = TriggerComp()  # -> linkedComp
#   port trigger: Trigger to expire the target component
# ---------- triggercomp_2: Python ----------
import Grasshopper as gh
import System
targetGuid = System.Guid("2d85b1f2-c939-4e0a-99e8-941e1276b5eb")
target = ghenv.Component.OnPingDocument().FindObject(targetGuid, False)
if trigger:
    target.ExpireSolution(True)
linkedComp = "2d85b1f2-c939-4e0a-99e8-941e1276b5eb"
# ---------- end triggercomp_2 ----------
cluster_4 = Cluster_2()

triggercomp_3 = TriggerComp()  # -> linkedComp
#   port trigger: Trigger to expire the target component
# ---------- triggercomp_3: Python ----------
import Grasshopper as gh
import System
targetGuid = System.Guid("eba1f0af-e57e-4f3e-b1f7-ce18a97d0a10")
target = ghenv.Component.OnPingDocument().FindObject(targetGuid, False)
if trigger:
    target.ExpireSolution(True)
linkedComp = "eba1f0af-e57e-4f3e-b1f7-ce18a97d0a10"
# ---------- end triggercomp_3 ----------
ghpython_script_4 = GhPythonScript()  # -> Out, A

# ----
panel = Panel(ghpython_script_3)

ghpython_script_5 = GhPythonScript()  # -> Out, A
data_2 = Data(cluster_3)
merge_2 = Merge(Data1=ghpython_script_5.A, Data2=ghpython_script_4.A, Data3=data_2)

# ----
# 4. Probing points & probing
number_slider = Slider(5, range=1..30)
brep = Brep(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)
brep_2 = Brep(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)
meshplane = MeshPlane(brep=brep, number=number_slider)
probing = Probing(Points=meshplane)

# ----
# 3. Mesh & Simulation
panel_2 = Panel("3")
panel_3 = Panel("C:\3_SimpleWindAnalysis")
panel_4 = Panel("100")
rset = RunSettings(
    NumberOfIterations=1000,
    WriteInterval=20,
    NumberOfTimestepsToKeep=3,
    TurbulenceModel=1,
    RelaxationFactors=3,
    SolutionAndAlgorithmControl=1,
    PotentialFoamInitialization=False,
    AgeOfAir=False,
    NumberOfCPUs="-1",
    OperatingSystem=0)

mset = MeshSettings(AccBuilding=2, AccFeatures=panel_2, AccBBox=0, AccGround=panel_2, MiscSettings=1, NumberOfLayers=4, Mode=2)

simulation = Simulation(
    SimulationDomain=domainbox.Domain,
    WorkingDirectory=panel_3,
    MeshSettings=mset,
    RunSettings=rset,
    RunMeshing=Button(),
    MakeTrees=False,
    RunSimulation=Toggle(True),
    runWithBlueCFD=True)
residuals = Residuals(Result=simulation, X=":", Y=":", Version=1, Run=Button(), visResiduals=True)

visprobes = VisualizeProbes(Result=simulation, ProbingPoints=probing, NameOfInstance="ttt", NameOfField=0, Run=Button())  # -> PorbingPoints, ProbingResult

# ----
# 5. Post-processing
# 5.1. Paraview
# 5.2. Grasshopper
# Wind vectors
points = Data(visprobes.PorbingPoints)
vectors = Data(visprobes.ProbingResult)
cluster_5 = Cluster(data=vectors)  # -> S, E, data_3
gradient = Gradient(
    LowerLimit=cluster_5.S,
    UpperLimit=Slider(5, range=0..10),
    Parameter=cluster_5.data_3,
    stops=[0.103: RGB(0, 0, 255), 0.22: RGB(0, 170, 255), 0.305: RGB(0, 255, 255), 0.398: RGB(0, 255, 188), 0.504: RGB(0, 255, 106), 0.605: RGB(91, 255, 0), 0.699: RGB(184, 255, 0), 0.799: RGB(255, 255, 0), 0.898: RGB(255, 170, 0)])
vdisex = VectorDisplayEx(Point=points, Vector=vectors, Colour=gradient, Width=Slider(2, range=0..10))

# ----
# 6. Clean
button = Button()
clean = Clean(Directory=panel_3, Mode=2, Run=button)

paraview = Paraview(Result=simulation, ParaviewVersion=2, Run=Button())

# ==== cluster MeshPlane
number = ClusterInput()
number_2 = Number(number)
settings_custom = SettingsCustom(
    StitchSeams=True,
    SimplePlanes=False,
    Refine=True,
    MinCount=16,
    MaxCount=400,
    AspectRatio=20,
    MaxDistance=0,
    MaxAngle=20,
    MinEdge=number_2,
    MaxEdge=number_2)
brep = ClusterInput()
mesh_brep = MeshBrep(Brep=brep, Settings=settings_custom)
deconstruct_mesh = DeconstructMesh(Mesh=mesh_brep)  # -> Vertices, Faces, Colours, Normals
vertices = ClusterOutput(deconstruct_mesh.Vertices)

# ==== cluster Cluster
data = ClusterInput()
data_2 = Data(data)
data_3 = ClusterOutput(data_2)
bnd = Bounds(Numbers=data_2)
dedomain = DeconstructDomain(Domain=bnd)  # -> Start, End
S = ClusterOutput(dedomain.Start)
E = ClusterOutput(dedomain.End)

# ==== cluster Cluster_2
geo = Geometry([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])
mesh = Mesh(geo)
mjoin = MeshJoin(Meshes=mesh)
M = ClusterOutput(mjoin)
